# Grasshopper definition Final 1.gh (Grasshopper 1.0.8)

geometry = Geometry([<surface referenced from the Rhino model> x8])
xy_plane = XYPlane(Origin=Point(0, 0, 0))
xy_plane_2 = XYPlane(Origin=Point(0, 0, 0))
xy_plane_3 = XYPlane(Origin=Point(0, 0, 0))
cylinder = Cylinder(Base=xy_plane_2, Radius=Slider(0.25, range=0..1), Length=Slider(0.25, range=0..1))
cylinder_2 = Cylinder(Base=xy_plane_3, Radius=Slider(0.05, range=0..1), Length=Slider(0.09, range=0..1))
maelstrom = Maelstrom(
    Geometry=geometry,
    Plane=xy_plane,
    First=Slider(0.25, range=0..1),
    Second=Slider(2, range=0..2),
    Angle=degrees(Slider(98, range=0..360)),
    Rigid=False)
cap_holes = CapHoles(Brep=cylinder)
cap_holes_2 = CapHoles(Brep=cylinder_2)
unit_z = UnitZ(Factor=Slider(0.25, range=0..1))
solid_difference = SolidDifference(BrepsA=cap_holes, BrepsB=cap_holes_2)
extrude = Extrude(Base=maelstrom, Direction=unit_z)
brep = Brep(extrude)
relay = Relay([solid_difference, brep])
brep_join = BrepJoin(Breps=relay)  # -> Breps, Closed
