# Grasshopper definition Final1.gh (Grasshopper 1.0.8)

geometry = Geometry([<curve referenced from the Rhino model> x8])
xy_plane = XYPlane(Origin=Point(0, 0, 0))
xy_plane_2 = XYPlane(Origin=Point(0, 0, 0))
maelstrom = Maelstrom(
    Geometry=geometry,
    Plane=xy_plane,
    First=Slider(0.24, range=0..1),
    Second=Slider(0.4, range=0..1),
    Angle=degrees(Slider(180, range=0..180)),
    Rigid=False)
circle = Circle(Plane=xy_plane_2, Radius=Slider(0.5, range=0..1))
