# Grasshopper definition L2.gh (Grasshopper 1.0.8)
# plug-ins: RhinoCodePluginGH

construct_point = ConstructPoint(XCoordinate=Slider(0, range=0..10), YCoordinate=Slider(0, range=0..10), ZCoordinate=Slider(0, range=0..10))
construct_point_2 = ConstructPoint(XCoordinate=Slider(0, range=0..10), YCoordinate=Slider(0, range=0..10), ZCoordinate=Slider(-1, range=-1..10))
python_3_script = Python3Script()  # -> out, a; unedited script template
xy_plane = XYPlane(Origin=construct_point)
vector_xyz = VectorXYZ(XComponent=Slider(0, range=0..2), YComponent=Slider(0, range=0..2), ZComponent=Slider(2, range=0..2))  # -> Vector, Length
xy_plane_2 = XYPlane(Origin=construct_point_2)
plane = Plane(xy_plane)
rectangle = Rectangle(Plane=plane, XSize=Slider(2, range=0..5), YSize=Slider(2, range=0..5), Radius=0)  # -> Rectangle, Length
cylinder = Cylinder(Base=xy_plane_2, Radius=Slider(1, range=0..2), Length=Slider(1, range=0..4))
plane_2 = Plane(rectangle.Rectangle)
extrude = Extrude(Base=plane_2, Direction=vector_xyz.Vector)
construct_point_3 = ConstructPoint(XCoordinate=Slider(0, range=0..2), YCoordinate=Slider(0, range=0..2), ZCoordinate=Slider(2, range=0..2))
construct_point_4 = ConstructPoint(XCoordinate=Slider(0, range=0..2), YCoordinate=Slider(0, range=0..2), ZCoordinate=Slider(0, range=0..2))
line = Line(StartPoint=construct_point_4, EndPoint=construct_point_3)
construct_point_5 = ConstructPoint(XCoordinate=Slider(0, range=0..2), YCoordinate=Slider(0, range=0..2), ZCoordinate=Slider(0, range=0..2))
twist = Twist(Geometry=extrude, Axis=line, Angle=Slider(2, range=0..5), Infinite=False, Rigid=False)
contour = Contour(Shape=twist, Point=construct_point_5, Direction=Vector(0, 0, 1), Distance=Slider(0.125, range=0..0.25))  # -> flatten(Contours)
move_to_plane = MoveToPlane(Geometry=contour, Plane=PlaneXY(0, 0, 0), Above=True, Below=True)  # -> Geometry, Transform
panel = Panel(contour)
move = Move(
    Geometry=move_to_plane.Geometry,
    Motion=[Vector(5.023376182, 6.8619408, 0), Vector(5.000616618, 4.024253123, 0), Vector(4.983754749, 0.9913715794, 0), Vector(4.985179698, -1.949467344, 0), Vector(5.026228936, -4.965220243, 0), Vector(1.958746751, 6.951646102, 0), Vector(2.039056983, 4.019692737, 0), Vector(1.99039625, 0.9640096788, 0), Vector(1.962429297, -1.932577273, 0), Vector(1.995160189, -5.025579666, 0), Vector(-0.8591835992, 6.945227909, 0), Vector(-1.053395151, 3.979042786, 0), Vector(-1.056238004, 1.115278912, 0), Vector(-1.027027775, -1.940300611, 0), Vector(-0.9943334065, -4.920828913, 0), Vector(-3.97378938, 0.03921521234, 0)])  # -> Geometry, Transform
text_on_surface = TextOnSurface(Text="A", Font="Sans Bold:no Italic:no", Height=0, Depth=5, BaseSurface=move.Geometry)
