# Grasshopper definition M3.gh (Grasshopper 1.0.8)

rectangle = Rectangle(Plane=PlaneXY(0, 0, 0), XSize=Slider(5, range=0..10), YSize=Slider(5, range=0..10), Radius=0)  # -> Rectangle, Length
series = Series(Start=0, Step=1, Count=Slider(20, range=0..20))
subtraction = Subtraction(B=Slider(10, range=0..10))
surface = Surface(rectangle.Rectangle)
offset_surface = OffsetSurface(Surface=surface, Distance=series, Retrim=True)
construct_domain = ConstructDomain(DomainStart=Slider(0.25, range=0..10), DomainEnd=subtraction)
area = Area(Geometry=offset_surface)  # -> Area, Centroid
unit_z = UnitZ(Factor=Slider(5, range=0..10))
range = Range(Domain=construct_domain, Steps=10)
scale = Scale(Geometry=offset_surface, Center=area.Centroid, Factor=range)  # -> Geometry, Transform
rectangle_2 = Rectangle(Plane=PlaneXY(0, 0, 0), XSize=Domain(-1, 1), YSize=Domain(-2, 2), Radius=0)  # -> Rectangle, Length
construct_point = ConstructPoint(XCoordinate=Slider(1, range=0..1), YCoordinate=Slider(1, range=0..1), ZCoordinate=Slider(1, range=0..1))
series_2 = Series(Start=0, Step=Slider(100, range=0..360), Count=10)
move = Move(Geometry=surface, Motion=unit_z)  # -> Geometry, Transform
rotate = Rotate(Geometry=scale.Geometry, Angle=degrees(series_2), Plane=area.Centroid)  # -> Geometry, Transform
divide_domain² = DivideDomain²(Domain=surface, UCount=Slider(3.305, range=0..10), VCount=Slider(4.492, range=0..10))
extrude_point = ExtrudePoint(Base=rectangle_2.Rectangle, Point=construct_point)
surface_box = SurfaceBox(Surface=rotate.Geometry, Domain=divide_domain², Height=1)
mesh_brep = MeshBrep(
    Brep=extrude_point,
    Settings={GridMaxCount=0, GridMinCount=16, JaggedSeams=False, MaxEdgeLength=0, MinEdgeLength=0.0001, MinTolerance=0, Refine=True, RefineAngle=0, RelativeTolerance=0.65, SimplePlanes=True, Tolerance=0})
bounding_box = BoundingBox(Content=mesh_brep, Plane=PlaneXY(0, 0, 0))  # -> Box, Box_2
box_morph = BoxMorph(Geometry=mesh_brep, Reference=bounding_box.Box, Target=surface_box)
