# Grasshopper definition Table copy.gh (Grasshopper 1.0.8)

construct_point = ConstructPoint(XCoordinate=0, YCoordinate=0, ZCoordinate=Slider(10, range=0..10))
construct_point_2 = ConstructPoint(XCoordinate=0, YCoordinate=0, ZCoordinate=Slider(0, range=0..10))
xy_plane = XYPlane(Origin=construct_point)
xy_plane_2 = XYPlane(Origin=construct_point_2)
number_slider = Slider(10, range=0..10)
rectangle = Rectangle(Plane=xy_plane_2, XSize=number_slider, YSize=number_slider, Radius=0)  # -> Rectangle, Length
vector_xyz = VectorXYZ(XComponent=Slider(0, range=0..2), YComponent=Slider(0, range=0..2), ZComponent=Slider(10, range=0..10))  # -> Vector, Length
construct_point_3 = ConstructPoint(XCoordinate=Slider(0, range=0..2), YCoordinate=Slider(0, range=0..2), ZCoordinate=Slider(10, range=0..10))
construct_point_4 = ConstructPoint(XCoordinate=Slider(0, range=0..2), YCoordinate=Slider(0, range=0..2), ZCoordinate=Slider(0, range=0..2))
plane = Plane(rectangle.Rectangle)
xy_plane_3 = XYPlane(Origin=construct_point)
extrude = Extrude(Base=plane, Direction=vector_xyz.Vector)
line = Line(StartPoint=construct_point_4, EndPoint=construct_point_3)
circle = Circle(Plane=xy_plane_3, Radius=Slider(9, range=0..30))
unit_z = UnitZ(Factor=Slider(2, range=0..5))
twist = Twist(Geometry=extrude, Axis=line, Angle=1.570796327, Infinite=False, Rigid=False)
surface = Surface(circle)
extrude_2 = Extrude(Base=surface, Direction=unit_z)
brep_join = BrepJoin(Breps=[twist, extrude_2])  # -> Breps, Closed
