# Grasshopper definition Table.gh (Grasshopper 1.0.8)

xy_plane = XYPlane(Origin=Point(0, 0, 0))
construct_point = ConstructPoint(XCoordinate=0, YCoordinate=0, ZCoordinate=Slider(10, range=0..10))
construct_point_2 = ConstructPoint(XCoordinate=0, YCoordinate=0, ZCoordinate=Slider(5, range=0..10))
circle = Circle(Plane=xy_plane, Radius=Slider(10, range=0..30))
xy_plane_2 = XYPlane(Origin=construct_point)
xy_plane_3 = XYPlane(Origin=construct_point_2)
circle_2 = Circle(Plane=xy_plane_2, Radius=Slider(16, range=0..30))
circle_3 = Circle(Plane=xy_plane_3, Radius=Slider(7, range=0..30))
loft = Loft(
    Curves=[circle_2, circle_3, circle],
    Options={Adjust=False, Closed=False, LoftEnds=0, LoftSimp=0, LoftType=0, Rebuild=10, Refit=0.01})
xy_plane_4 = XYPlane(Origin=construct_point)
circle_4 = Circle(Plane=xy_plane_4, Radius=Slider(16, range=0..30))
unit_z = UnitZ(Factor=Slider(2, range=0..5))
surface = Surface(circle_4)
extrude = Extrude(Base=surface, Direction=unit_z)
brep_join = BrepJoin(Breps=[extrude, loft])  # -> Breps, Closed
