# Grasshopper definition chair copy 2.gh (Grasshopper 1.0.8)

construct_point = ConstructPoint(XCoordinate=Slider(20, range=0..20), YCoordinate=0, ZCoordinate=Slider(10, range=0..10))
construct_point_2 = ConstructPoint(XCoordinate=Slider(20, range=0..20), YCoordinate=0, ZCoordinate=Slider(0, range=0..10))
construct_point_3 = ConstructPoint(XCoordinate=Slider(20, range=0..20), YCoordinate=0, ZCoordinate=Slider(5, range=0..10))
xy_plane = XYPlane(Origin=construct_point)
xy_plane_2 = XYPlane(Origin=construct_point_3)
xy_plane_3 = XYPlane(Origin=construct_point_2)
construct_point_4 = ConstructPoint(XCoordinate=Slider(20, range=0..20), YCoordinate=0, ZCoordinate=Slider(10, range=0..10))
xy_plane_4 = XYPlane(Origin=construct_point_4)
circle = Circle(Plane=xy_plane, Radius=Slider(6, range=0..10))
circle_2 = Circle(Plane=xy_plane_2, Radius=Slider(4, range=0..10))
circle_3 = Circle(Plane=xy_plane_3, Radius=Slider(8, range=0..10))
circle_4 = Circle(Plane=xy_plane_4, Radius=Slider(16, range=0..20))
loft = Loft(
    Curves=[circle, circle_2, circle_3],
    Options={Adjust=False, Closed=False, LoftEnds=0, LoftSimp=0, LoftType=0, Rebuild=10, Refit=0.01})
unit_z = UnitZ(Factor=Slider(2, range=0..5))
extrude = Extrude(Base=circle_4, Direction=unit_z)
curve = Curve()
cap_holes = CapHoles(Brep=extrude)
brep_join = BrepJoin(Breps=[cap_holes, loft])  # -> Breps, Closed
construct_point_5 = ConstructPoint(XCoordinate=Slider(32, range=0..40), YCoordinate=Slider(-2, range=-10..40), ZCoordinate=Slider(17, range=0..30))
construct_point_6 = ConstructPoint(XCoordinate=Slider(20, range=0..40), YCoordinate=Slider(14, range=0..20), ZCoordinate=Slider(30, range=0..30))
construct_point_7 = ConstructPoint(XCoordinate=Slider(4, range=0..40), YCoordinate=Slider(-2, range=-10..40), ZCoordinate=Slider(17, range=0..30))
number_slider = Slider(4, range=0..5)
number_slider_2 = Slider(2, range=0..5)
number_slider_3 = Slider(4, range=0..5)
xz_plane = XZPlane(Origin=construct_point_5)
yz_plane = YZPlane(Origin=construct_point_6)
xz_plane_2 = XZPlane(Origin=construct_point_7)
rectangle = Rectangle(Plane=xz_plane, XSize=number_slider, YSize=number_slider, Radius=Slider(2, range=0..5))  # -> Rectangle, Length
rectangle_2 = Rectangle(Plane=yz_plane, XSize=number_slider_2, YSize=number_slider_2, Radius=Slider(2, range=0..5))  # -> Rectangle, Length
rectangle_3 = Rectangle(Plane=xz_plane_2, XSize=number_slider_3, YSize=number_slider_3, Radius=Slider(2, range=0..5))  # -> Rectangle, Length
loft_2 = Loft(
    Curves=[rectangle.Rectangle, rectangle_2.Rectangle, rectangle_3.Rectangle],
    Options={Adjust=False, Closed=False, LoftEnds=0, LoftSimp=0, LoftType=0, Rebuild=10, Refit=0.01})
construct_point_8 = ConstructPoint(XCoordinate=Slider(6, range=0..40), YCoordinate=0, ZCoordinate=Slider(11, range=0..30))
construct_point_9 = ConstructPoint(XCoordinate=Slider(6, range=0..40), YCoordinate=0, ZCoordinate=Slider(17, range=0..30))
construct_point_10 = ConstructPoint(XCoordinate=Slider(20, range=0..40), YCoordinate=Slider(14, range=0..20), ZCoordinate=Slider(11, range=0..30))
construct_point_11 = ConstructPoint(XCoordinate=Slider(20, range=0..40), YCoordinate=Slider(15, range=0..20), ZCoordinate=Slider(30, range=0..31))
construct_point_12 = ConstructPoint(XCoordinate=Slider(34, range=0..40), YCoordinate=0, ZCoordinate=Slider(11, range=0..30))
construct_point_13 = ConstructPoint(XCoordinate=Slider(34, range=0..40), YCoordinate=0, ZCoordinate=Slider(17, range=0..30))
xy_plane_5 = XYPlane(Origin=construct_point_8)
xy_plane_6 = XYPlane(Origin=construct_point_9)
xy_plane_7 = XYPlane(Origin=construct_point_10)
xy_plane_8 = XYPlane(Origin=construct_point_11)
xy_plane_9 = XYPlane(Origin=construct_point_12)
xy_plane_10 = XYPlane(Origin=construct_point_13)
circle_5 = Circle(Plane=xy_plane_5, Radius=Slider(2, range=0..5))
circle_6 = Circle(Plane=xy_plane_6, Radius=Slider(2, range=0..5))
circle_7 = Circle(Plane=xy_plane_7, Radius=Slider(1, range=0..5))
circle_8 = Circle(Plane=xy_plane_8, Radius=Slider(1, range=0..5))
circle_9 = Circle(Plane=xy_plane_9, Radius=Slider(2, range=0..5))
circle_10 = Circle(Plane=xy_plane_10, Radius=Slider(2, range=0..5))
loft_3 = Loft(
    Curves=[circle_6, circle_5],
    Options={Adjust=False, Closed=False, LoftEnds=0, LoftSimp=0, LoftType=0, Rebuild=10, Refit=0.01})
loft_4 = Loft(
    Curves=[circle_8, circle_7],
    Options={Adjust=False, Closed=False, LoftEnds=0, LoftSimp=0, LoftType=0, Rebuild=10, Refit=0.01})
loft_5 = Loft(
    Curves=[circle_10, circle_9],
    Options={Adjust=False, Closed=False, LoftEnds=0, LoftSimp=0, LoftType=0, Rebuild=10, Refit=0.01})
construct_point_14 = ConstructPoint(XCoordinate=Slider(34, range=0..40), YCoordinate=0, ZCoordinate=Slider(18, range=0..30))
construct_point_15 = ConstructPoint(XCoordinate=Slider(6, range=0..40), YCoordinate=0, ZCoordinate=Slider(18, range=0..30))
xy_plane_11 = XYPlane(Origin=construct_point_14)
xy_plane_12 = XYPlane(Origin=construct_point_15)
sphere = Sphere(Base=xy_plane_11, Radius=Slider(2, range=0..5))
sphere_2 = Sphere(Base=xy_plane_12, Radius=Slider(2, range=0..5))
brep_join_2 = BrepJoin(Breps=[loft_3, loft_4, loft_5, loft_2, brep_join.Breps, sphere_2, sphere])  # -> Breps, Closed
solid_union = SolidUnion(Breps=[brep_join.Breps, loft_2, loft_5, loft_4, loft_3, sphere, sphere_2])
